% Simulink design studies designstudy.mldatx for model Final_Model_3

study "TorqueSS": 10000 simulations
  combinatorial set (10000 points):
    "Variable_1": Variable(Name=config.Td), values 1:10:100000 (10000 points)